# Grasshopper definition ladybug-simulatiion-PythonGeoFinished.gh (Grasshopper 1.0.7)

# ---- group: Geometry settup / position
number_slider = Slider(-2, range=-20..20)
number_slider_2 = Slider(3, range=-20..20)

# ---- group: Geometry settup
number_slider_3 = Slider(4, range=0..10)
number_slider_4 = Slider(14, range=0..20)
number_slider_5 = Slider(5, range=0..10)
multiplication = Multiplication(A=number_slider_5, B=number_slider_3)
ghpython_script = GhPythonScript(size=number_slider_4, xExtend=number_slider_5, yExtend=number_slider_3, xPos=number_slider_2, yPos=number_slider)  # -> out, x, y
# ---------- ghpython_script: Python ----------
x = xPos - xExtend/2*size
y = yPos - yExtend/2 * size
# ---------- end ghpython_script ----------
vb = VBScript(genelist="GeneList A", count=multiplication)  # -> out, A
# ---------- vb: VB usings ----------
Imports System.IO
Imports System.Linq
Imports System.Data
Imports System.Drawing
Imports System.Reflection
Imports System.Windows.Forms
Imports System.Xml
Imports System.Xml.Linq
Imports System.Runtime.InteropServices

Imports Rhino.DocObjects
Imports Rhino.Collections
Imports GH_IO
Imports GH_IO.Serialization
# ---------- vb: VB ----------
    For Each obj As IGH_DocumentObject In owner.OnPingDocument().Objects
      If (obj.ComponentGuid <> New Guid("{21553c44-ea62-475e-a8bb-62b2a3ee5ca5}")) Then Continue For
      If (obj.NickName Like genelist) Then
        CallByName(obj, "Count", CallType.Set, count)
        'CallByName(obj, "ExpireSolution", CallType.Method, False)
        Return
      End If
    Next

    Print("No matching Gene list object found")
# ---------- end vb ----------
construct_point = ConstructPoint(XCoordinate=ghpython_script.x, YCoordinate=ghpython_script.y, ZCoordinate=0)
rectangular = Rectangular(Plane=construct_point, SizeX=number_slider_4, SizeY=number_slider_4, ExtentX=number_slider_5, ExtentY=number_slider_3)  # -> Cells, Points
genelist_a = GeneList(
    Decimals=2,
    Maximum=100,
    Minimum=0,
    Value=[38.71992256, 4.316250144, 71.09403199, 78.00678996, 86.16550122, 79.48342998, 86.18742856, 94.3, 72.96361424, 50.18245692, 29.81500166, 20.27362884, 68.6960718, 25.53231419, 15.40387464, 3.047472426, 43.08507584, 9.035173202, 35.7871995, 65.28030837])
rotate = Rotate(Geometry=rectangular.Cells, Angle=degrees(Slider(166, range=0..360)), Plane=PlaneXY(0, 0, 0))  # -> Geometry, Transform
curve = Curve(flatten(rotate.Geometry))
unit_z = UnitZ(Factor=genelist_a)
panel = Panel(curve)
extrude = Extrude(Base=curve, Direction=unit_z)

# ----
ladybug = Ladybug_Ladybug()  # -> out; plug-in component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
updateghfile = Ladybug_UpdateFile(update=Toggle(True))  # -> readMe; plug-in component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
panel_2 = Panel(ladybug)
panel_3 = Panel(updateghfile)
file_path = FilePath("C:\Users\ander\Documents\RRG\NOR_Oslo.Fornebu.014880_IWEC.epw")
path = FilePath("C:\Users\ander\Downloads\neigbours.3dm")
cap_holes = CapHoles(Brep=extrude)
_3dm = Import3DM(File=path, Layer="*", Name="*")
gencumulativeskymtx = Ladybug_GenCumulativeSkyMtx(epwFile=file_path, skyDensity=0, useOldRes=True, runIt=Toggle(True))  # -> out, cumulativeSkyMtx; plug-in component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
analysisperiod = Ladybug_AnalysisPeriod(
    fromMonth=Slider(9, range=1..12),
    fromDay=Slider(1, range=1..31),
    fromHour=Slider(1, range=1..24),
    toMonth=Slider(10, range=1..12),
    toDay=Slider(31, range=1..31),
    toHour=Slider(24, range=1..24))  # -> out, analysisPeriod; plug-in component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
preview = CustomPreview(Geometry=_3dm, Material=ColourSwatch(SwatchColor=RGB(122, 122, 122)))
debrep = DeconstructBrep(Brep=cap_holes)  # -> Faces, Edges, Vertices
skindesigner = SkinDesigner_SkinDesigner()  # -> out; plug-in component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
mesh = MeshBrep(
    Brep=[cap_holes, _3dm],
    Settings={GridMaxCount=0, GridMinCount=16, JaggedSeams=False, MaxEdgeLength=0, MinEdgeLength=0.0001, MinTolerance=0, Refine=True, RefineAngle=0, RelativeTolerance=0.65, SimplePlanes=True, Tolerance=0})
volume = Volume(Geometry=mesh)  # -> Volume, Centroid
srf = Surface(debrep.Faces)
selectskymtx = Ladybug_selectSkyMtx(
    cumulativeSkyMtx=gencumulativeskymtx.cumulativeSkyMtx,
    analysisPeriod=analysisperiod.analysisPeriod,
    removeDiffuse=False,
    removeDirect=False)  # -> out, selectedSkyMtx; plug-in component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
item = ListItem(List=volume.Volume, Index=3, Wrap=True)
item_2 = ListItem(List=volume.Volume, Index=0, Wrap=True)
item_3 = ListItem(List=volume.Volume, Index=1, Wrap=True)
item_4 = ListItem(List=volume.Volume, Index=2, Wrap=True)
num = Number(-1)
num_2 = Number(50000)
addition = Addition(A=item_2, B=item_3, C=item_4, D=item)
galapagos = Galapagos(fitness=num_3)
multiplication_2 = Multiplication(A=addition, B=num)
number_slider_6 = Slider(1, range=0..1)
list = ValueList({"PANEL RULES": "", "NO OPENINGS ON SHORTER PANEL": "AddConditionalDefinition('PanelHeight < 13.8', 'DeleteWindow()')", "NO OPENINGS ON NARROWER PANEL": "AddConditionalDefinition('PanelWidth < 3.4', 'DeleteWindow()')"}, selected="NO OPENINGS ON SHORTER PANEL")
list_2 = ValueList({"PANEL RULES": "", "NO OPENINGS ON SHORTER PANEL": "AddConditionalDefinition('PanelHeight < 14', 'DeleteWindow()')", "NO OPENINGS ON NARROWER PANEL": "AddConditionalDefinition('PanelWidth < 3.4', 'DeleteWindow()')"}, selected="NO OPENINGS ON NARROWER PANEL")

# ----
# LAYOUT FUNCTIONS
# (scene units should be set in feet)
panel_4 = Panel("PanelWidth")
system_wall = SkinDesigner_SystemWall(tileWidth=panel_4, tileHeight="PanelHeight", tileThickness="10/12", tileJoint="0", tileEdgeOffset="0")  # -> out, panelSystem; plug-in component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
# PANEL
systemspanel = SkinDesigner_SystemsPanel(
    name="Panel_AS32",
    activate=Toggle(True),
    width="3.5",
    height="14",
    thickness="4/12",
    panelSystem=system_wall.panelSystem)  # -> out, flatten(panel), panelDefinition; inputs activate: Boolean, definitions: list, panelSystem: list, windowSystem: list, shadingSystems: list, customSystem: list; plug-in component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

division = Division(A=multiplication_2, B=num_2)
vector = Vector(Vector(-22.99649002, 0.1665877054, 0))
panel_5 = Panel(division)
preview_2 = CustomPreview(Geometry=mesh, Material=ColourSwatch(SwatchColor=RGB(255, 255, 255)))
python_script = PythonScript(rules=[list_2, list])  # -> R; inputs rules: list
# ---------- python_script: Python ----------
R=""
for text in rules:
    R += text +"\r\n"

print R
# ---------- end python_script ----------
radiationanalysis = Ladybug_RadiationAnalysis(
    north=vector,
    geometry=flatten(mesh),
    gridSize=Slider(8, range=0..10),
    disFromBase=Slider(1, range=0..1),
    selectedSkyMtx=flatten(selectskymtx.selectedSkyMtx),
    runIt=Toggle(True))  # -> out, contextMesh, analysisMesh, testPts, testVec, port, radiationResult, radiationMesh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; plug-in component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
data = Data(python_script)

unit_y = UnitY(Factor=1)
brep = Brep(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)
system_wall_2 = SkinDesigner_SystemWall()  # -> out, panelSystem; plug-in component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
window = SkinDesigner_Window(width="PanelWidth", height="PanelHeight-4.5", fromBottom="4.5", recess="-4/12")  # -> out, windowSystem; plug-in component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
customgeometry = SkinDesigner_CustomGeometry(geometry=flatten(brep), upAxisVector=unit_y, trimToPanelSize=Toggle(True))  # -> out, customSystem; inputs geometry: list, upAxisVector: Vector3d, placementVector: Vector3d, scaleVector: Vector3d, tilable: Boolean, trimToPanelSize: Boolean; plug-in component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
# PANEL
systemspanel_2 = SkinDesigner_SystemsPanel(
    name="Panel_AW64",
    activate=Toggle(True),
    definitions=data,
    width="3.5",
    height="14",
    thickness="4/12",
    panelSystem=system_wall_2.panelSystem,
    windowSystem=window.windowSystem,
    customSystem=customgeometry.customSystem)  # -> out, flatten(panel), panelDefinition; inputs activate: Boolean, definitions: list, panelSystem: list, windowSystem: list, shadingSystems: list, customSystem: list; plug-in component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

number = Number(radiationanalysis.totalRadiation)
addition_2 = Addition(A=radiationanalysis.totalRadiation, B=division)
num_3 = Number(addition_2)
pt = Point(Point(4.517450797, 1.066557573, 0))
panel_6 = Panel(number)
panelviewer = SkinDesigner_PanelViewer(panel=flatten(systemspanel.panel), drawGeometry=Toggle(False), locPoint=pt)  # -> out, Breps; inputs panel: list, drawGeometry: Boolean, drawBreps: Boolean; plug-in component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
skin_surface = Brep(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)
panel_7 = Panel(addition_2)
panel_8 = Panel(panelviewer.out)
window_2 = SkinDesigner_Window(width="PanelWidth", height="PanelHeight-1.5", fromBottom="1.5", recess="0")  # -> windowSystem; plug-in component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

# ----
# PANEL
systemspanel_3 = SkinDesigner_SystemsPanel(
    name="Panel_AOW32",
    activate=Toggle(True),
    definitions=data,
    width="3.5",
    height="14",
    thickness="4/12",
    panelSystem=system_wall_2.panelSystem,
    windowSystem=window_2)  # -> out, flatten(panel), panelDefinition; inputs activate: Boolean, definitions: list, panelSystem: list, windowSystem: list, shadingSystems: list, customSystem: list; plug-in component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

# ----
# SKIN GENERATOR
list_3 = ValueList({"DEFAULT OFFSET LEVEL": "DEFAULT_OFFSET_LEVEL", "DEFAULT OFFSET PATH": "DEFAULT_OFFSET_PATH", "DEFAULT SKIN WRAP": "DEFAULT_SKIN_WRAP", "RESET BAY AT POINTS": "RESET_BAY_AT_POINTS", "MINIMUM PANEL WIDTH": "MIN_PANEL_WIDTH", "MINIMUM PANEL HEIGHT": "MIN_PANEL_HEIGHT", "GENERATE PANELS ONLY": "GENERATE_PANELS_ONLY"}, selected="DEFAULT SKIN WRAP")
list_4 = ValueList({"VERTICAL OFFSET": "DEFAULT_OFFSET_LEVEL", "HORIZONTAL OFFSET": "DEFAULT_OFFSET_PATH", "DEFAULT SKIN WRAP": "DEFAULT_SKIN_WRAP", "RESET BAY AT POINTS": "RESET_BAY_AT_POINTS", "MINIMUM PANEL WIDTH": "MIN_PANEL_WIDTH", "MINIMUM PANEL HEIGHT": "MIN_PANEL_HEIGHT", "GENERATE PANELS ONLY": "GENERATE_PANELS_ONLY"}, selected="VERTICAL OFFSET")
list_5 = ValueList({"VERTICAL OFFSET": "DEFAULT_OFFSET_LEVEL", "HORIZONTAL OFFSET": "DEFAULT_OFFSET_PATH", "DEFAULT SKIN WRAP": "DEFAULT_SKIN_WRAP", "RESET BAY AT POINTS": "RESET_BAY_AT_POINTS", "MINIMUM PANEL WIDTH": "MIN_PANEL_WIDTH", "MINIMUM PANEL HEIGHT": "MIN_PANEL_HEIGHT", "GENERATE PANELS ONLY": "GENERATE_PANELS_ONLY"}, selected="HORIZONTAL OFFSET")
skinparameters = SkinDesigner_SkinParameters(
    skinName="SKIN_NAME",
    parameter_1=list_3,
    value_1=Toggle(True),
    parameter_2=list_4,
    value_2=Slider(3, range=0..8),
    parameter_3=list_5,
    value_3=Slider(2, range=0..3))  # -> out, skinParameters; inputs defaultBayList: list of Int32; plug-in component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
skingenerator = SkinDesigner_SkinGenerator(
    activate=Toggle(True),
    skinParameters=skinparameters.skinParameters,
    skinSurfaceList=flatten(srf),
    panel_1=systemspanel.panel,
    panel_2=systemspanel_3.panel,
    panel_3=systemspanel_2.panel)  # -> out, postProcData, skinBayData, skinPanelData; inputs skinParameters: list, skinSurfaceList: list, designControllers: list, postProcFunctions: list, panel_1: list, panel_2: list, panel_3: list, panel_4: list; plug-in component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

panel_9 = Panel(skingenerator.out)
